# Grasshopper definition function_add.gh (Grasshopper 1.0.7)

get_number111 = GetNumber(Slider(1, range=0..1), AtLeast=1, AtMost=1, Maximum=1.797693135e+308, Minimum=-1.797693135e+308, TreeAccess=False)
get_number2 = GetNumber(Slider(11, range=0..100), AtLeast=1, AtMost=1, Maximum=1.797693135e+308, Minimum=-1.797693135e+308, TreeAccess=False)
addition = Addition(A=get_number111, B=get_number2)

# ---- group: RH_OUT
num = Number(addition)
